# Grasshopper definition MoorilumeGH.gh (Grasshopper 1.0.7)
# plug-ins: Bifocals, Pufferfish, Parakeet

# Requirements
# Requirements:
# - Plugins: Parakeet (https://www.food4rhino.com/en/app/parakeet)
# - Only single surfaces accepted
# - For closed surfaces and edge joining, X Dimension value should be even
# - For closed surface, Sweep2 recommended for consistant edge normals
xy_plane = XYPlane(Origin=Point(0, 0, 0))

# ----
# Depth
number_slider = Slider(5, range=0..10)

# ----
# Angle
number_slider_2 = Slider(0.36, range=0.2..0.5)

# ----
# Pattern Selection
pattern_id = Slider(12, range=0..12)

# ----
# Taper
boolean_toggle = BooleanToggle(False)

# ----
# Scaling
x_closed = BooleanToggle(True)
X = Slider(1.05, range=0..2)
Y = Slider(1, range=0..2)

# ----
# Inputs
# Surface
surface = Surface(<surface referenced from the Rhino model>)

# ----
# XY Dimension
X_2 = Slider(4, range=0..20)
Y_2 = Slider(2, range=0..20)

division = Division(A=X_2, B=Slider(2, range=0..10))
subtraction = Subtraction(A=division, B=Slider(1, range=0..1))

# ----
# Bugged Patterns (2)
cluster = Cluster_16(plane=xy_plane, extend_x=X_2, extend_y=Y_2, relay=xy_plane, relay_2=X_2, count=Y_2)

cluster_2 = Cluster_14(
    plane_10=xy_plane,
    extend_x_10=X_2,
    extend_y_10=Y_2,
    index_9=subtraction,
    plane=xy_plane,
    extend_x=X_2,
    extend_y=Y_2,
    index=subtraction,
    plane_6=xy_plane,
    extend_x_6=X_2,
    extend_y_6=Y_2,
    index_2=subtraction,
    plane_7=xy_plane,
    extend_x_7=X_2,
    extend_y_7=Y_2,
    index_3=subtraction,
    plane_11=xy_plane,
    extend_x_11=X_2,
    extend_y_11=Y_2,
    index_10=subtraction,
    plane_12=xy_plane,
    extend_x_12=X_2,
    extend_y_12=Y_2,
    index_11=subtraction,
    plane_13=xy_plane,
    extend_x_13=X_2,
    extend_y_13=Y_2,
    index_12=subtraction,
    plane_9=xy_plane,
    extend_x_9=X_2,
    X=X_2,
    extend_y_9=Y_2,
    Y=Y_2,
    index_4=subtraction,
    plane_2=xy_plane,
    extend_x_2=X_2,
    extend_y_2=Y_2,
    index_5=subtraction,
    plane_4=xy_plane,
    extend_x_4=X_2,
    extend_y_4=Y_2,
    index_6=subtraction,
    plane_5=xy_plane,
    extend_x_5=X_2,
    extend_y_5=Y_2,
    index_13=subtraction,
    plane_8=xy_plane,
    extend_x_8=X_2,
    extend_y_8=Y_2,
    index_7=subtraction,
    plane_3=xy_plane,
    extend_x_3=X_2,
    extend_y_3=Y_2,
    index_8=subtraction)  # -> grid_cells, i_9, weave_2, i, list, i_2, list_2, i_3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
cluster_3 = Cluster_15(
    gate=pattern_id,
    _0=cluster_2.grid_cells,
    _1=cluster_2.weave_2,
    _2=cluster_2.list,
    _3=cluster_2.list_2,
    _4=cluster_2.grid_cells_2,
    _5=cluster_2.grid_cells_3,
    _6=cluster_2.grid_cells_4,
    _7=cluster_2.result,
    _8=cluster_2.result_2,
    _9=cluster_2.result_3,
    _10=cluster_2.result_4,
    _11=cluster_2.result_5,
    _12=cluster_2.result_6,
    gate_2=pattern_id,
    _0_2=cluster_2.i_9,
    _1_2=cluster_2.i,
    _2_2=cluster_2.i_2,
    _3_2=cluster_2.i_3,
    _4_2=cluster_2.i_10,
    _5_2=cluster_2.i_11,
    _6_2=cluster_2.i_12,
    _7_2=cluster_2.i_4,
    _8_2=cluster_2.i_5,
    _9_2=cluster_2.i_6,
    _10_2=cluster_2.i_13,
    _11_2=cluster_2.i_7,
    _12_2=cluster_2.i_8)  # -> pattern_port, x_scale_port
cluster_4 = Cluster_3(curve=cluster_3.pattern_port, values_a=cluster_3.pattern_port, base_grid=cluster_3.pattern_port, angle=number_slider_2)  # -> joinedbreps, relay_2
cluster_5 = Cluster_4(relay=cluster_4.relay_2, content=cluster_4.joinedbreps)  # -> geometry, length_2
deconstruct_domain² = DeconstructDomain²(Domain=surface)  # -> UComponent, VComponent

# ----
# Taper Controls
number_slider_3 = Slider(1, range=0..100)

# ----
# Output
join_tolerance = Slider(10, range=0..10)

# ----
# Taper
bounding_rectangle = BoundingRectangle(Geometry=cluster_4.joinedbreps, Plane=PlaneXY(0, 0, 0), Axis=0, Slide=0, Union=True)  # -> Bounding, DimensionX, DimensionY
explode = Explode(Curve=bounding_rectangle.Bounding, Recursive=True)  # -> Segments, Vertices
list_item = ListItem(List=explode.Segments, Index=0, Wrap=True)
list_item_2 = ListItem(List=explode.Segments, Index="2", Wrap=True)
curve_middle = CurveMiddle(Curve=list_item)
curve_middle_2 = CurveMiddle(Curve=list_item_2)

line = Line(StartPoint=curve_middle, EndPoint=curve_middle_2)
taper = Taper(
    Geometry=cluster_5.geometry,
    Axis=line,
    Start=Slider(100, range=0..100),
    End=number_slider_3,
    Flat=True,
    Infinite=True,
    Rigid=False)

brep_join = BrepJoin(Breps=taper)  # -> Breps, Closed

stream_filter = StreamFilter(Gate=boolean_toggle, Stream0=cluster_4.joinedbreps, Stream1=brep_join.Breps)

# ----
# Scaling
bounding_rectangle_2 = BoundingRectangle(Geometry=stream_filter, Plane=PlaneXY(0, 0, 0), Axis=0, Slide=0, Union=True)  # -> Bounding, DimensionX, DimensionY
unit_z = UnitZ(Factor=cluster_5.length_2)
move = Move(Geometry=bounding_rectangle_2.Bounding, Motion=unit_z)  # -> Geometry, Transform
bounding_box = BoundingBox(Content=stream_filter, Plane=PlaneXY(0, 0, 0))  # -> Box, Box_2
stream_filter_2 = StreamFilter(Gate=x_closed, Stream0=X, Stream1=cluster_3.x_scale_port)
scale_nu = ScaleNU(Geometry=bounding_box.Box, Plane=move.Geometry, ScaleX=stream_filter_2, ScaleY=Y, ScaleZ=1)  # -> Geometry, Transform

stream_filter_3 = StreamFilter(Gate=boolean_toggle, Stream0=cluster_5.geometry, Stream1=stream_filter)
# Y
# Boundary Moved 1
# Boundary Moved 1
# Inner Moved
# Inner Moved
# Inner Moved
# Outer Moved
# Outer Moved
# Boundary Moved 2
# Boundary Moved 2
# End Point
# Tangent 1
# Tangent 2
# Tangent 3
# Vert Tangent 1
# Vert Tangent 2
# Vert Tangent 3
surface_morph = SurfaceMorph(
    Geometry=stream_filter_3,
    Reference=scale_nu.Geometry,
    Surface=surface,
    UDomain=deconstruct_domain².UComponent,
    VDomain=deconstruct_domain².VComponent,
    WDomain=number_slider)

brep_join_plus = BrepJoinPlus(Breps=surface_morph, Tolerance=join_tolerance)

# ==== cluster Cluster_3

unit_z = UnitZ(Factor=Slider(1, range=0..1))

curve = ClusterInput()
values_a = ClusterInput()
base_grid = ClusterInput()
angle = ClusterInput()

# ----
# Point Extraction and Bezier Curves
cluster = Cluster_2(
    curve=curve,
    values_a=values_a,
    base_grid=base_grid,
    angle=angle,
    motion_5=unit_z,
    motion_6=unit_z,
    motion_7=unit_z,
    motion_8=unit_z,
    motion=unit_z,
    motion_2=unit_z,
    motion_3=unit_z,
    motion_4=unit_z)  # -> points, points_2, points_3, points_4, result_5, result_6, result_7, result_8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

# ----
# Tangent Lines and Bezier Curves
cluster_2 = Cluster(
    geometry=cluster.points,
    geometry_4=cluster.points_2,
    A=unit_z,
    geometry_3=cluster.points_3,
    geometry_2=cluster.points_4,
    geometry_7=cluster.result_5,
    A_4=unit_z,
    geometry_8=cluster.result_6,
    A_5=unit_z,
    geometry_6=cluster.result_7,
    A_3=unit_z,
    geometry_5=cluster.result_8,
    A_2=unit_z,
    geometry_11=cluster.result,
    A_8=unit_z,
    geometry_12=cluster.result_2,
    A_9=unit_z,
    geometry_10=cluster.result_3,
    A_7=unit_z,
    geometry_9=cluster.result_4,
    A_6=unit_z)  # -> curve, curve_2, curve_21, curve_22, line_33, curve_3, curve_23, curve_24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

loft = Loft(Curves=cluster.weave_8, Options=cluster.options)
loft_2 = Loft(Curves=cluster.weave_5, Options=cluster.options)
loft_3 = Loft(Curves=cluster.weave_6, Options=cluster.options)
loft_4 = Loft(Curves=cluster.weave_7, Options=cluster.options)

# ----
# Surfaces
boundary_surfaces = BoundarySurfaces(Edges=[cluster_2.curve, cluster_2.line_33, cluster_2.line_25])
boundary_surfaces_2 = BoundarySurfaces(Edges=[cluster_2.curve_2, cluster_2.line_34, cluster_2.line_26])
boundary_surfaces_3 = BoundarySurfaces(Edges=[cluster_2.curve_3, cluster_2.line_35, cluster_2.line_27])
boundary_surfaces_4 = BoundarySurfaces(Edges=[cluster_2.curve_4, cluster_2.line_36, cluster_2.line_28])

boundary_surfaces_5 = BoundarySurfaces(Edges=[cluster_2.line_37, cluster_2.curve_5, cluster_2.line_29])
boundary_surfaces_6 = BoundarySurfaces(Edges=[cluster_2.line_38, cluster_2.curve_6, cluster_2.line_30])
boundary_surfaces_7 = BoundarySurfaces(Edges=[cluster_2.line_39, cluster_2.curve_7, cluster_2.line_31])
boundary_surfaces_8 = BoundarySurfaces(Edges=[cluster_2.line_40, cluster_2.curve_8, cluster_2.line_32])

loft_5 = Loft(Curves=[cluster_2.curve_21, cluster_2.curve_29, cluster_2.curve_25], Options=cluster_2.options)
loft_6 = Loft(Curves=[cluster_2.curve_22, cluster_2.curve_30, cluster_2.curve_26], Options=cluster_2.options)
loft_7 = Loft(Curves=[cluster_2.curve_23, cluster_2.curve_31, cluster_2.curve_27], Options=cluster_2.options)
loft_8 = Loft(Curves=[cluster_2.curve_24, cluster_2.curve_32, cluster_2.curve_28], Options=cluster_2.options)

brep_join = BrepJoin(Breps=[loft, boundary_surfaces, boundary_surfaces_5, loft_5])  # -> flatten(Breps), Closed
brep_join_2 = BrepJoin(Breps=[boundary_surfaces_2, loft_2, boundary_surfaces_6, loft_6])  # -> flatten(Breps), Closed
brep_join_3 = BrepJoin(Breps=[loft_3, boundary_surfaces_3, boundary_surfaces_7, loft_7])  # -> flatten(Breps), Closed
brep_join_4 = BrepJoin(Breps=[loft_4, boundary_surfaces_4, boundary_surfaces_8, loft_8])  # -> flatten(Breps), Closed

brep_join_plus = BrepJoinPlus(Breps=[brep_join.Breps, brep_join_2.Breps, brep_join_3.Breps, brep_join_4.Breps], Tolerance=Slider(0.1, range=0..0.1))
relay = Relay([brep_join_4.Breps, brep_join_3.Breps, brep_join_2.Breps, brep_join.Breps])
relay_2 = ClusterOutput(relay)
joinedbreps = ClusterOutput(brep_join_plus)

# ==== cluster Cluster_4
content = ClusterInput()
relay = ClusterInput()

# ----
# Rotate Open Faces to Surface
bounding_box = BoundingBox(Content=content, Plane=PlaneXY(0, 0, 0))  # -> Box, Box_2
deconstruct_brep = DeconstructBrep(Brep=bounding_box.Box)  # -> Faces, Edges, Vertices
list_item = ListItem(List=deconstruct_brep.Edges, Index=Slider(10, range=0..11), Wrap=True)
list_item_2 = ListItem(List=deconstruct_brep.Faces, Index=0, Wrap=True)
list_item_3 = ListItem(List=deconstruct_brep.Faces, Index=Slider(2, range=0..6), Wrap=True)
polygon_center = PolygonCenter(Polyline=list_item_3)  # -> CenterV, CenterE, CenterA
polygon_center_2 = PolygonCenter(Polyline=list_item_2)  # -> CenterV, CenterE, CenterA
length = Length(Curve=list_item)
line = Line(StartPoint=polygon_center.CenterV, EndPoint=polygon_center_2.CenterV)
unit_x = UnitX(Factor=Slider(0.12, range=0..2))
move = Move(Geometry=line, Motion=unit_x)  # -> Geometry, Transform
rotate_axis = RotateAxis(Geometry=relay, Angle=3.141592654, Axis=move.Geometry)  # -> Geometry, Transform

length_2 = ClusterOutput(length)
geometry = ClusterOutput(rotate_axis.Geometry)

# ==== cluster Cluster_14
plane = ClusterInput()
extend_x = ClusterInput()
extend_y = ClusterInput()
plane_2 = ClusterInput()
extend_x_2 = ClusterInput()
extend_y_2 = ClusterInput()
plane_3 = ClusterInput()
extend_x_3 = ClusterInput()
extend_y_3 = ClusterInput()
plane_4 = ClusterInput()
extend_x_4 = ClusterInput()
extend_y_4 = ClusterInput()
plane_5 = ClusterInput()
extend_x_5 = ClusterInput()
extend_y_5 = ClusterInput()
plane_6 = ClusterInput()
extend_x_6 = ClusterInput()
extend_y_6 = ClusterInput()
plane_7 = ClusterInput()
extend_x_7 = ClusterInput()
extend_y_7 = ClusterInput()
plane_8 = ClusterInput()
extend_x_8 = ClusterInput()
extend_y_8 = ClusterInput()
plane_9 = ClusterInput()
extend_x_9 = ClusterInput()
extend_y_9 = ClusterInput()
X = ClusterInput()
Y = ClusterInput()
plane_10 = ClusterInput()
extend_x_10 = ClusterInput()
extend_y_10 = ClusterInput()
plane_11 = ClusterInput()
extend_x_11 = ClusterInput()
extend_y_11 = ClusterInput()
plane_12 = ClusterInput()
extend_x_12 = ClusterInput()
extend_y_12 = ClusterInput()
plane_13 = ClusterInput()
extend_x_13 = ClusterInput()
extend_y_13 = ClusterInput()
index = ClusterInput()

rhombitrihexagonal = Rhombitrihexagonal(Plane=plane, Size=1, ExtendX=extend_x, ExtendY=extend_y)
cluster = Cluster_6(list=rhombitrihexagonal)  # -> panel_2, list_2, polyline_2
panel = Panel(""".9044
.9498
.9660
.9742
.9792
.9826
.9852
.9870
.9885
.9895""")
weave = Weave(Pattern=cluster.panel_2, Stream0=cluster.list_2, Stream1=cluster.polyline_2, NullGaps=False)
list_item = ListItem(List=panel, Index=index, Wrap=True)

index_2 = ClusterInput()

snub_square = SnubSquare(Plane=plane_6, Size=1, ExtendX=extend_x_6, ExtendY=extend_y_6)
cluster_2 = Cluster_7(list=snub_square)  # -> list_2, result
panel_2 = Panel(""".6667
.8000
.8572
.8890
.9090
.9230
.9333
.9412
.9474
.9524""")
insert_items = InsertItems(List=cluster_2.list_2, Item=cluster_2.result, Indices=1, Wrap=True)
list_item_2 = ListItem(List=panel_2, Index=index_2, Wrap=True)

index_3 = ClusterInput()

snub_trihexagonal = SnubTrihexagonal(Plane=plane_7, Size=1, ExtendX=extend_x_7, ExtendY=extend_y_7)
cluster_3 = Cluster_8(list=snub_trihexagonal)  # -> list_2, weave_2
panel_3 = Panel(""".9656
.9825
.9882
.9912
.9930
.9940
.9950
.9955
.9960
.9965""")
insert_items_2 = InsertItems(List=cluster_3.list_2, Item=cluster_3.weave_2, Indices=25, Wrap=True)
list_item_3 = ListItem(List=panel_3, Index=index_3, Wrap=True)

index_4 = ClusterInput()

truncated_trihexagonal = TruncatedTrihexagonal(Plane=plane_9, Size=1, ExtendX=extend_x_9, ExtendY=extend_y_9)
cluster_4 = Cluster_13(list=truncated_trihexagonal, X=X, Y=Y)
panel_4 = Panel(""".7760
.8740
.9125
.9328
.9455
.9540
.9605
.9650
.9690
.9720""")
merge = Merge(Data1=cluster_4)
list_item_4 = ListItem(List=panel_4, Index=index_4, Wrap=True)

index_5 = ClusterInput()

_2_uniform_tiling_c = _2UniformTilingC(Plane=plane_2, Size=1, ExtendX=extend_x_2, ExtendY=extend_y_2)
cluster_5 = Cluster_5(list=_2_uniform_tiling_c)  # -> list_2, polyline_10, polyline_7, polyline_9, polyline_8, polyline_12, polyline_11
panel_5 = Panel(""".8256
.9045
.9342
.9500
.9596
.9662
.9707
.9743
.9772
.9795""")
merge_2 = Merge(
    Data1=cluster_5.list_2,
    Data2=cluster_5.polyline_10,
    Data3=cluster_5.polyline_7,
    Data4=cluster_5.polyline_9,
    Data5=cluster_5.polyline_8,
    Data6=cluster_5.polyline_12,
    Data7=cluster_5.polyline_11)
list_item_5 = ListItem(List=panel_5, Index=index_5, Wrap=True)

index_6 = ClusterInput()

_2_uniform_tiling_d = _2UniformTilingD(Plane=plane_4, Size=1, ExtendX=extend_x_4, ExtendY=extend_y_4)
cluster_6 = Cluster_9(list=_2_uniform_tiling_d)  # -> list_2, polyline_5, polyline_6, polyline_4
panel_6 = Panel(""".7760
.8740
.9122
.9325
.9455
.9540
.9605
.9650
.9690
.9720""")
merge_3 = Merge(Data1=cluster_6.list_2, Data2=cluster_6.polyline_5, Data3=cluster_6.polyline_6, Data4=cluster_6.polyline_4)
list_item_6 = ListItem(List=panel_6, Index=index_6, Wrap=True)

index_7 = ClusterInput()

_2_uniform_tiling_f = _2UniformTilingF(Plane=plane_8, Size=1, ExtendX=extend_x_8, ExtendY=extend_y_8)
cluster_7 = Cluster_11(list=_2_uniform_tiling_f)  # -> list_2, polyline_3, polyline_4
panel_7 = Panel(""".8572
.9232
.9474
.9600
.9678
.9730
.9768
.9796
.9820
.9838""")
merge_4 = Merge(Data1=cluster_7.list_2, Data2=cluster_7.polyline_3, Data3=cluster_7.polyline_4)
list_item_7 = ListItem(List=panel_7, Index=index_7, Wrap=True)

index_8 = ClusterInput()

_4_uniform_tiling_a = _4UniformTilingA(Plane=plane_3, Size=1, ExtendX=extend_x_3, ExtendY=extend_y_3)
cluster_8 = Cluster_12(list=_4_uniform_tiling_a)  # -> list_2, polyline_9, polyline_10, polyline_8, polyline_7, polyline_6
panel_8 = Panel(""".6474
.7860
.8464
.8800
.9020
.9168
.9280
.9362
.9430
.9485""")
merge_5 = Merge(
    Data1=cluster_8.list_2,
    Data2=cluster_8.polyline_9,
    Data3=cluster_8.polyline_10,
    Data4=cluster_8.polyline_8,
    Data5=cluster_8.polyline_7,
    Data6=cluster_8.polyline_6)
scale_modifier = ListItem(List=panel_8, Index=index_8, Wrap=True)

index_9 = ClusterInput()
index_10 = ClusterInput()
index_11 = ClusterInput()
index_12 = ClusterInput()
index_13 = ClusterInput()

_2_uniform_tiling_e = _2UniformTilingE(Plane=plane_5, Size=1, ExtendX=extend_x_5, ExtendY=extend_y_5)
cluster_9 = Cluster_10(list=_2_uniform_tiling_e)  # -> polyline_4, polyline_6, polyline_5, list_2
panel_9 = Panel(""".8454
.9162
.9424
.9564
.9648
.9704
.9746
.9778
.9800
.9820""")
merge_6 = Merge(Data1=cluster_9.polyline_4, Data2=cluster_9.polyline_6, Data3=cluster_9.polyline_5, Data4=cluster_9.list_2)
list_item_8 = ListItem(List=panel_9, Index=index_13, Wrap=True)

panel_10 = Panel(""".8724
.9320
.9536
.9645
.9716
.9760
.9795
.9820
.9840
.9858""")
truncated_square = TruncatedSquare(Plane=plane_13, Size=1, ExtendX=extend_x_13, ExtendY=extend_y_13)
list_item_9 = ListItem(List=panel_10, Index=index_12, Wrap=True)

panel_11 = Panel(""".6120
.7592
.8256
.8632
.8875
.9045
.9170
.9266
.9342
.9405""")
truncated_hexagonal = TruncatedHexagonal(Plane=plane_12, Size=1, ExtendX=extend_x_12, ExtendY=extend_y_12)
list_item_10 = ListItem(List=panel_11, Index=index_11, Wrap=True)

panel_12 = Panel(""".5000
.6668
.7500
.8000
.8335
.8570
.8750
.8890
.9000
.9090""")
elongated_triangular = ElongatedTriangular(Plane=plane_10, Size=1, ExtendX=extend_x_10, ExtendY=extend_y_10)
list_item_11 = ListItem(List=panel_12, Index=index_9, Wrap=True)

panel_13 = Panel(""".8890
.9412
.9600
.9696
.9756
.9796
.9826
.9847
.9862
1.0000""")
trihexagonal = Trihexagonal(Plane=plane_11, Size=1, ExtendX=extend_x_11, ExtendY=extend_y_11)
list_item_12 = ListItem(List=panel_13, Index=index_10, Wrap=True)

grid_cells = ClusterOutput(elongated_triangular)
weave_2 = ClusterOutput(weave)
i = ClusterOutput(list_item)
list = ClusterOutput(insert_items)
i_2 = ClusterOutput(list_item_2)
list_2 = ClusterOutput(insert_items_2)
i_3 = ClusterOutput(list_item_3)
grid_cells_2 = ClusterOutput(trihexagonal)
grid_cells_3 = ClusterOutput(truncated_hexagonal)
grid_cells_4 = ClusterOutput(truncated_square)
result = ClusterOutput(merge)
i_4 = ClusterOutput(list_item_4)
result_2 = ClusterOutput(merge_2)
i_5 = ClusterOutput(list_item_5)
result_3 = ClusterOutput(merge_3)
i_6 = ClusterOutput(list_item_6)
result_4 = ClusterOutput(merge_6)
result_5 = ClusterOutput(merge_4)
i_7 = ClusterOutput(list_item_7)
result_6 = ClusterOutput(merge_5)
i_8 = ClusterOutput(scale_modifier)
i_9 = ClusterOutput(list_item_11)
i_10 = ClusterOutput(list_item_12)
i_11 = ClusterOutput(list_item_10)
i_12 = ClusterOutput(list_item_9)
i_13 = ClusterOutput(list_item_8)

# ==== cluster Cluster_15
gate = ClusterInput()
_0 = ClusterInput()
_1 = ClusterInput()
_2 = ClusterInput()
_3 = ClusterInput()
_4 = ClusterInput()
_5 = ClusterInput()
_6 = ClusterInput()
_7 = ClusterInput()
_8 = ClusterInput()
_9 = ClusterInput()
_10 = ClusterInput()
_11 = ClusterInput()
_12 = ClusterInput()
gate_2 = ClusterInput()
_0_2 = ClusterInput()
_1_2 = ClusterInput()
_2_2 = ClusterInput()
_3_2 = ClusterInput()
_4_2 = ClusterInput()
_5_2 = ClusterInput()
_6_2 = ClusterInput()
_7_2 = ClusterInput()
_8_2 = ClusterInput()
_9_2 = ClusterInput()
_10_2 = ClusterInput()
_11_2 = ClusterInput()
_12_2 = ClusterInput()
stream_filter = StreamFilter(
    Gate=gate,
    Stream0=_0,
    Stream1=_1,
    Stream2=_2,
    Stream3=_3,
    Stream4=_4,
    Stream5=_5,
    Stream6=_6,
    Stream7=_7,
    Stream8=_8,
    Stream9=_9,
    Stream10=_10,
    Stream11=_11,
    Stream12=_12)
stream_filter_2 = StreamFilter(
    Gate=gate_2,
    Stream0=_0_2,
    Stream1=_1_2,
    Stream2=_2_2,
    Stream3=_3_2,
    Stream4=_4_2,
    Stream5=_5_2,
    Stream6=_6_2,
    Stream7=_7_2,
    Stream8=_8_2,
    Stream9=_9_2,
    Stream10=_10_2,
    Stream11=_11_2,
    Stream12=_12_2)
pattern_port = ClusterOutput(stream_filter)
x_scale_port = ClusterOutput(stream_filter_2)

# ==== cluster Cluster_16
relay = ClusterInput()
number_slider = Slider(1, range=0..1)
plane = ClusterInput()
extend_x = ClusterInput()
extend_y = ClusterInput()

panel = Panel("BUG")
_2_uniform_tiling_a = _2UniformTilingA(Plane=plane, Size=1, ExtendX=extend_x, ExtendY=extend_y)

number_slider_2 = Slider(3, range=0..10)
relay_2 = ClusterInput()
number_slider_3 = Slider(6, range=0..10)
vector_xyz = VectorXYZ(XComponent=Slider(2.82, range=1..10), YComponent=Slider(4.81, range=1..10), ZComponent=0)  # -> Vector, Length
count = ClusterInput()

_2_uniform_tiling_b = _2UniformTilingB(Plane=relay, Size=1, ExtendX=number_slider_2, ExtendY=number_slider_2)

list_item = ListItem(List=_2_uniform_tiling_b, Index=Slider(11, range=0..16), Wrap=True)
list_item_2 = ListItem(List=_2_uniform_tiling_b, Index=[0, 1, 2, 3, 4, 5, 6, 7, 8, 9, 10, 11], Wrap=True)
list_item_3 = ListItem(List=_2_uniform_tiling_b, Index=Slider(9, range=0..16), Wrap=True)
control_points = ControlPoints(Curve=list_item_3)  # -> Points, Weights, Knots
control_points_2 = ControlPoints(Curve=list_item)  # -> Points, Weights, Knots
list_item_4 = ListItem(List=control_points.Points, Index=Slider(2, range=0..6), Wrap=True)
list_item_5 = ListItem(List=control_points_2.Points, Index=Slider(9, range=0..12), Wrap=True)
line = Line(StartPoint=list_item_4, EndPoint=list_item_5)
vector_xyz_2 = VectorXYZ(XComponent=line, YComponent=0, ZComponent=0)  # -> Vector, Length
linear_array = LinearArray(Geometry=list_item_2, Direction=vector_xyz_2.Vector, Count=relay_2)  # -> flatten(Geometry), Transform
linear_array_2 = LinearArray(Geometry=linear_array.Geometry, Direction=vector_xyz.Vector, Count=count)  # -> Geometry, Transform

merge = Merge(Data1=linear_array.Geometry)

# ==== cluster Cluster
A = ClusterInput()
A_2 = ClusterInput()
A_3 = ClusterInput()
A_4 = ClusterInput()
A_5 = ClusterInput()
A_6 = ClusterInput()
A_7 = ClusterInput()
A_8 = ClusterInput()
A_9 = ClusterInput()
geometry = ClusterInput()
geometry_2 = ClusterInput()
geometry_3 = ClusterInput()
geometry_4 = ClusterInput()

# ----
# Boundary Moved 1
panel = Panel("1")
multiplication = Multiplication(A=A, B=panel)
move = Move(Geometry=geometry, Motion=multiplication)  # -> Geometry, Transform
move_2 = Move(Geometry=geometry_2, Motion=multiplication)  # -> Geometry, Transform
move_3 = Move(Geometry=geometry_3, Motion=multiplication)  # -> Geometry, Transform
move_4 = Move(Geometry=geometry_4, Motion=multiplication)  # -> Geometry, Transform

geometry_5 = ClusterInput()
geometry_6 = ClusterInput()
geometry_7 = ClusterInput()
geometry_8 = ClusterInput()

# ----
# Inner Moved
panel_2 = Panel("1")
multiplication_2 = Multiplication(A=A_2, B="1")
multiplication_3 = Multiplication(A=A_3, B="1")
multiplication_4 = Multiplication(A=A_4, B=panel_2)
multiplication_5 = Multiplication(A=A_5, B="1")
move_5 = Move(Geometry=geometry_5, Motion=multiplication_2)  # -> Geometry, Transform
move_6 = Move(Geometry=geometry_6, Motion=multiplication_3)  # -> Geometry, Transform
move_7 = Move(Geometry=geometry_7, Motion=multiplication_4)  # -> Geometry, Transform
move_8 = Move(Geometry=geometry_8, Motion=multiplication_5)  # -> Geometry, Transform

geometry_9 = ClusterInput()
geometry_10 = ClusterInput()
geometry_11 = ClusterInput()
geometry_12 = ClusterInput()

# ----
# Outer Moved
panel_3 = Panel("1")
multiplication_6 = Multiplication(A=A_6, B="1")
multiplication_7 = Multiplication(A=A_7, B="1")
multiplication_8 = Multiplication(A=A_8, B=panel_3)
multiplication_9 = Multiplication(A=A_9, B="1")
move_9 = Move(Geometry=geometry_9, Motion=multiplication_6)  # -> Geometry, Transform
move_10 = Move(Geometry=geometry_10, Motion=multiplication_7)  # -> Geometry, Transform
move_11 = Move(Geometry=geometry_11, Motion=multiplication_8)  # -> Geometry, Transform
move_12 = Move(Geometry=geometry_12, Motion=multiplication_9)  # -> Geometry, Transform

shift_list = ShiftList(List=move_7.Geometry, Shift=0, Wrap=True)
shift_list_2 = ShiftList(List=move_8.Geometry, Shift=0, Wrap=True)
shift_list_3 = ShiftList(List=move_6.Geometry, Shift=0, Wrap=True)
shift_list_4 = ShiftList(List=move_5.Geometry, Shift=0, Wrap=True)

shift_list_5 = ShiftList(List=move_11.Geometry, Shift=0, Wrap=True)
shift_list_6 = ShiftList(List=move_12.Geometry, Shift=0, Wrap=True)
shift_list_7 = ShiftList(List=move_10.Geometry, Shift=0, Wrap=True)
shift_list_8 = ShiftList(List=move_9.Geometry, Shift=0, Wrap=True)

move_13 = Move(Geometry=shift_list_8, Motion=multiplication_2)  # -> Geometry, Transform
move_14 = Move(Geometry=shift_list_7, Motion=multiplication_3)  # -> Geometry, Transform
move_15 = Move(Geometry=shift_list_5, Motion=multiplication_4)  # -> Geometry, Transform
move_16 = Move(Geometry=shift_list_6, Motion=multiplication_5)  # -> Geometry, Transform

shift_list_9 = ShiftList(List=move_11.Geometry, Shift=-1, Wrap=True)
shift_list_10 = ShiftList(List=move_12.Geometry, Shift=1, Wrap=True)
shift_list_11 = ShiftList(List=move_10.Geometry, Shift=1, Wrap=True)
shift_list_12 = ShiftList(List=move_9.Geometry, Shift=1, Wrap=True)

move_17 = Move(Geometry=shift_list_12, Motion=multiplication_6)  # -> Geometry, Transform
move_18 = Move(Geometry=shift_list_11, Motion=multiplication_7)  # -> Geometry, Transform
move_19 = Move(Geometry=shift_list_9, Motion=multiplication_8)  # -> Geometry, Transform
move_20 = Move(Geometry=shift_list_10, Motion=multiplication_9)  # -> Geometry, Transform

shift_list_13 = ShiftList(List=move.Geometry, Shift=-1, Wrap=True)
shift_list_14 = ShiftList(List=move_4.Geometry, Shift=0, Wrap=True)
shift_list_15 = ShiftList(List=move_3.Geometry, Shift=0, Wrap=True)  # -> simplify(List)
shift_list_16 = ShiftList(List=move_2.Geometry, Shift=0, Wrap=True)

# ----
# Boundary Moved 2
move_21 = Move(Geometry=shift_list_13, Motion=multiplication)  # -> Geometry, Transform
move_22 = Move(Geometry=shift_list_14, Motion=multiplication)  # -> Geometry, Transform
move_23 = Move(Geometry=shift_list_15, Motion=multiplication)  # -> Geometry, Transform
move_24 = Move(Geometry=shift_list_16, Motion=multiplication)  # -> Geometry, Transform

sub_list = SubList(List=shift_list_15, Domain=Domain(0, 1), Wrap=True)  # -> List, Index
panel_4 = Panel(sub_list.List)

line = Line(StartPoint=move_15.Geometry, EndPoint=shift_list_5)
line_2 = Line(StartPoint=move_16.Geometry, EndPoint=shift_list_6)
line_3 = Line(StartPoint=move_14.Geometry, EndPoint=shift_list_7)
line_4 = Line(StartPoint=move_13.Geometry, EndPoint=shift_list_8)

line_5 = Line(StartPoint=move_21.Geometry, EndPoint=shift_list_13)
line_6 = Line(StartPoint=move_22.Geometry, EndPoint=shift_list_14)
line_7 = Line(StartPoint=move_23.Geometry, EndPoint=shift_list_15)
line_8 = Line(StartPoint=move_24.Geometry, EndPoint=shift_list_16)

line_9 = Line(StartPoint=move_19.Geometry, EndPoint=shift_list_9)
line_10 = Line(StartPoint=move_20.Geometry, EndPoint=shift_list_10)
line_11 = Line(StartPoint=move_18.Geometry, EndPoint=shift_list_11)
line_12 = Line(StartPoint=move_17.Geometry, EndPoint=shift_list_12)

line_13 = Line(StartPoint=shift_list, EndPoint=shift_list_5)
line_14 = Line(StartPoint=shift_list_2, EndPoint=shift_list_6)
line_15 = Line(StartPoint=shift_list_3, EndPoint=shift_list_7)
line_16 = Line(StartPoint=shift_list_4, EndPoint=shift_list_8)

line_17 = Line(StartPoint=shift_list, EndPoint=shift_list_13)
line_18 = Line(StartPoint=shift_list_2, EndPoint=shift_list_14)
line_19 = Line(StartPoint=shift_list_3, EndPoint=shift_list_15)
line_20 = Line(StartPoint=shift_list_4, EndPoint=shift_list_16)

line_21 = Line(StartPoint=shift_list, EndPoint=shift_list_9)
line_22 = Line(StartPoint=shift_list_2, EndPoint=shift_list_10)
line_23 = Line(StartPoint=shift_list_3, EndPoint=shift_list_11)
line_24 = Line(StartPoint=shift_list_4, EndPoint=shift_list_12)

line_25 = ClusterOutput(line)
line_26 = ClusterOutput(line_2)
line_27 = ClusterOutput(line_3)
line_28 = ClusterOutput(line_4)
line_29 = ClusterOutput(line_9)
line_30 = ClusterOutput(line_10)
line_31 = ClusterOutput(line_11)
line_32 = ClusterOutput(line_12)
line_33 = ClusterOutput(line_13)
line_34 = ClusterOutput(line_14)
line_35 = ClusterOutput(line_15)
line_36 = ClusterOutput(line_16)
line_37 = ClusterOutput(line_21)
line_38 = ClusterOutput(line_22)
line_39 = ClusterOutput(line_23)
line_40 = ClusterOutput(line_24)
point_list = PointList(Points=shift_list_15, Size=Slider(0.1, range=0..1))
point_list_2 = PointList(Points=shift_list_7, Size=Slider(0.1, range=0..1))
point_list_3 = PointList(Points=shift_list_11, Size=Slider(0.1, range=0..1))
point_list_4 = PointList(Points=shift_list_3, Size=Slider(0.1, range=0..1))

bezier_span = BezierSpan(StartPoint=shift_list, StartTangent=line_13, EndPoint=move_15.Geometry, EndTangent=line)  # -> Curve, Length, Domain
bezier_span_2 = BezierSpan(StartPoint=shift_list_2, StartTangent=line_14, EndPoint=move_16.Geometry, EndTangent=line_2)  # -> Curve, Length, Domain
bezier_span_3 = BezierSpan(StartPoint=shift_list_3, StartTangent=line_15, EndPoint=move_14.Geometry, EndTangent=line_3)  # -> Curve, Length, Domain
bezier_span_4 = BezierSpan(StartPoint=shift_list_4, StartTangent=line_16, EndPoint=move_13.Geometry, EndTangent=line_4)  # -> Curve, Length, Domain

bezier_span_5 = BezierSpan(StartPoint=shift_list, StartTangent=line_17, EndPoint=move_21.Geometry, EndTangent=line_5)  # -> Curve, Length, Domain
bezier_span_6 = BezierSpan(StartPoint=shift_list_2, StartTangent=line_18, EndPoint=move_22.Geometry, EndTangent=line_6)  # -> Curve, Length, Domain
bezier_span_7 = BezierSpan(StartPoint=shift_list_3, StartTangent=line_19, EndPoint=move_23.Geometry, EndTangent=line_7)  # -> Curve, Length, Domain
bezier_span_8 = BezierSpan(StartPoint=shift_list_4, StartTangent=line_20, EndPoint=move_24.Geometry, EndTangent=line_8)  # -> Curve, Length, Domain

bezier_span_9 = BezierSpan(StartPoint=shift_list, StartTangent=line_21, EndPoint=move_19.Geometry, EndTangent=line_9)  # -> Curve, Length, Domain
bezier_span_10 = BezierSpan(StartPoint=shift_list_2, StartTangent=line_22, EndPoint=move_20.Geometry, EndTangent=line_10)  # -> Curve, Length, Domain
bezier_span_11 = BezierSpan(StartPoint=shift_list_3, StartTangent=line_23, EndPoint=move_18.Geometry, EndTangent=line_11)  # -> Curve, Length, Domain
bezier_span_12 = BezierSpan(StartPoint=shift_list_4, StartTangent=line_24, EndPoint=move_17.Geometry, EndTangent=line_12)  # -> Curve, Length, Domain

curve = ClusterOutput(bezier_span.Curve)
curve_2 = ClusterOutput(bezier_span_2.Curve)
curve_3 = ClusterOutput(bezier_span_3.Curve)
curve_4 = ClusterOutput(bezier_span_4.Curve)
curve_5 = ClusterOutput(bezier_span_9.Curve)
curve_6 = ClusterOutput(bezier_span_10.Curve)
curve_7 = ClusterOutput(bezier_span_11.Curve)
curve_8 = ClusterOutput(bezier_span_12.Curve)
point_on_curve = PointOnCurve(line_9, parameter=0.5)
point_on_curve_2 = PointOnCurve(bezier_span_9.Curve, parameter=0.5)
point_on_curve_3 = PointOnCurve(line_21, parameter=0.5)
point_list_5 = PointList(Points=point_on_curve, Size=Slider(0.1, range=0..0.1))
point_list_6 = PointList(Points=point_on_curve_2, Size=Slider(0.1, range=0..0.1))
point_list_7 = PointList(Points=point_on_curve_3, Size=Slider(0.1, range=0..0.1))
loft_options = LoftOptions(Closed=False, Adjust=False, Rebuild=0, Refit=0, Type=3)

curve_9 = Curve(simplify(graft(bezier_span.Curve)))
curve_10 = Curve(simplify(graft(bezier_span_2.Curve)))
curve_11 = Curve(simplify(graft(bezier_span_3.Curve)))
curve_12 = Curve(simplify(graft(bezier_span_4.Curve)))

curve_13 = Curve(simplify(graft(bezier_span_9.Curve)))
curve_14 = Curve(simplify(graft(bezier_span_10.Curve)))
curve_15 = Curve(simplify(graft(bezier_span_11.Curve)))
curve_16 = Curve(simplify(graft(bezier_span_12.Curve)))

curve_17 = Curve(simplify(graft(bezier_span_5.Curve)))
curve_18 = Curve(simplify(graft(bezier_span_6.Curve)))
curve_19 = Curve(simplify(graft(bezier_span_7.Curve)))
curve_20 = Curve(simplify(graft(bezier_span_8.Curve)))

curve_21 = ClusterOutput(curve_9)
curve_22 = ClusterOutput(curve_10)
curve_23 = ClusterOutput(curve_11)
curve_24 = ClusterOutput(curve_12)
options = ClusterOutput(loft_options)
curve_25 = ClusterOutput(curve_13)
curve_26 = ClusterOutput(curve_14)
curve_27 = ClusterOutput(curve_15)
curve_28 = ClusterOutput(curve_16)
curve_29 = ClusterOutput(curve_17)
curve_30 = ClusterOutput(curve_18)
curve_31 = ClusterOutput(curve_19)
curve_32 = ClusterOutput(curve_20)

# ==== cluster Cluster_2
base_grid = ClusterInput()
angle = ClusterInput()
curve = ClusterInput()
star_pattern_i = StarPatternI(BaseGrid=base_grid, Angle=angle, Distance=0, ShiftSize=0, BulgeFactor=0)
length = Length(Curve=curve)
network_regions = NetworkRegions(Curves=star_pattern_i)  # -> flatten(Regions)
values_a = ClusterInput()
panel = Panel(network_regions)
sort_list = SortList(Keys=length, ValuesValuesA=network_regions)  # -> Keys, ValuesValuesA
sort_list_2 = SortList(Keys=length, ValuesValuesA=values_a)  # -> Keys, ValuesValuesA
reverse_list = ReverseList(List=sort_list_2.ValuesValuesA)
reverse_list_2 = ReverseList(List=sort_list.ValuesValuesA)
length_2 = Length(Curve=reverse_list)
length_3 = Length(Curve=reverse_list)
create_set = CreateSet(List=length_2)  # -> Set, Map
create_set_2 = CreateSet(List=length_3)  # -> Set, Map
panel_2 = Panel("""1
3
5
9
11
15
17
19
23
25
30
32
34
38
40""")
member_index = MemberIndex(Set=length_2, Member=create_set.Set)  # -> Index, Count
member_index_2 = MemberIndex(Set=length_3, Member=create_set_2.Set)  # -> Index, Count
list_item = ListItem(List=reverse_list, Index=member_index.Index, Wrap=True)
list_item_2 = ListItem(List=reverse_list_2, Index=member_index_2.Index, Wrap=True)
explode_tree = ExplodeTree(Data=list_item)  # -> Branch0, Branch1, Branch2, Branch3
explode_tree_2 = ExplodeTree(Data=list_item_2)  # -> Branch0, Branch1, Branch2, Branch3

star_1 = Curve(explode_tree_2.Branch0)
star_2 = Curve(explode_tree_2.Branch1)

# ---- group: Curve
star_3 = Curve(explode_tree_2.Branch2)
star_4 = Curve(explode_tree_2.Branch3)

# ----
shape_1 = Curve(explode_tree.Branch0)
shape_2 = Curve(explode_tree.Branch1)
shape_3 = Curve(explode_tree.Branch2)
shape_4 = Curve(explode_tree.Branch3)

# ---- group: Control Points
control_points = ControlPoints(Curve=star_3)  # -> Points, Weights, Knots
control_points_2 = ControlPoints(Curve=star_4)  # -> Points, Weights, Knots

# ----
control_points_3 = ControlPoints(Curve=star_1)  # -> Points, Weights, Knots
control_points_4 = ControlPoints(Curve=star_2)  # -> Points, Weights, Knots
cull_duplicates = CullDuplicates(Points=control_points_3.Points, Tolerance=0.1, CullMode=3)  # -> Points, Indices, Valence
cull_duplicates_2 = CullDuplicates(Points=control_points_4.Points, Tolerance=0.1, CullMode=3)  # -> Points, Indices, Valence
cull_duplicates_3 = CullDuplicates(Points=control_points.Points, Tolerance=0.1, CullMode=3)  # -> Points, Indices, Valence
cull_duplicates_4 = CullDuplicates(Points=control_points_2.Points, Tolerance=0.1, CullMode=3)  # -> Points, Indices, Valence

# ----
# Bounding Points
control_points_5 = ControlPoints(Curve=shape_1)  # -> Points, Weights, Knots
control_points_6 = ControlPoints(Curve=shape_2)  # -> Points, Weights, Knots
control_points_7 = ControlPoints(Curve=shape_3)  # -> Points, Weights, Knots
control_points_8 = ControlPoints(Curve=shape_4)  # -> Points, Weights, Knots
shape_1_2 = CullDuplicates(Points=control_points_5.Points, Tolerance=0.1, CullMode=3)  # -> Points, Indices, Valence
shape_2_2 = CullDuplicates(Points=control_points_6.Points, Tolerance=0.1, CullMode=3)  # -> Points, Indices, Valence
shape_3_2 = CullDuplicates(Points=control_points_7.Points, Tolerance=0.1, CullMode=3)  # -> Points, Indices, Valence
shape_4_2 = CullDuplicates(Points=control_points_8.Points, Tolerance=0.1, CullMode=3)  # -> Points, Indices, Valence

# ---- group: Centres / Polygon Center
# Centre Points
polygon_center = PolygonCenter(Polyline=shape_1)  # -> graft(CenterV), CenterE, CenterA

# ---- group: Centres
polygon_center_2 = PolygonCenter(Polyline=shape_2)  # -> graft(CenterV), CenterE, CenterA
polygon_center_3 = PolygonCenter(Polyline=shape_3)  # -> graft(CenterV), CenterE, CenterA
polygon_center_4 = PolygonCenter(Polyline=shape_4)  # -> graft(CenterV), CenterE, CenterA

# ----
panel_3 = Panel("""0
1""")
panel_4 = Panel("""0
1""")
panel_5 = Panel("""0
1""")
panel_6 = Panel("""0
1""")
dispatch = Dispatch(List=cull_duplicates.Points, DispatchPattern=panel_3)  # -> ListA, ListB
dispatch_2 = Dispatch(List=cull_duplicates_2.Points, DispatchPattern=panel_4)  # -> ListA, ListB
dispatch_3 = Dispatch(List=cull_duplicates_3.Points, DispatchPattern=panel_5)  # -> ListA, ListB
dispatch_4 = Dispatch(List=cull_duplicates_4.Points, DispatchPattern=panel_6)  # -> ListA, ListB
outside_points_unfiltered = Point(simplify(dispatch_2.ListB))
outside_points_unfiltered_2 = Point(simplify(dispatch_4.ListB))
outside_points_unfiltered_3 = Point(simplify(dispatch.ListB))
outside_points_unfiltered_4 = Point(simplify(dispatch_3.ListB))
inside_points_unfiltered = Point(simplify(dispatch.ListA))
inside_points_unfiltered_2 = Point(simplify(dispatch_2.ListA))
inside_points_unfiltered_3 = Point(simplify(dispatch_4.ListA))
inside_points_unfiltered_4 = Point(simplify(dispatch_3.ListA))
centre_to_inside = Distance(PointA=polygon_center.CenterV, PointB=inside_points_unfiltered)
distance = Distance(PointA=polygon_center.CenterV, PointB=outside_points_unfiltered_3)
centre_to_inside_2 = Distance(PointA=polygon_center_3.CenterV, PointB=inside_points_unfiltered_4)
centre_to_inside_3 = Distance(PointA=polygon_center_4.CenterV, PointB=inside_points_unfiltered_3)
distance_2 = Distance(PointA=polygon_center_3.CenterV, PointB=outside_points_unfiltered_4)
distance_3 = Distance(PointA=polygon_center_4.CenterV, PointB=outside_points_unfiltered_2)
centre_to_inside_4 = Distance(PointA=polygon_center_2.CenterV, PointB=inside_points_unfiltered_2)
distance_4 = Distance(PointA=polygon_center_2.CenterV, PointB=outside_points_unfiltered)
smaller_than = SmallerThan(FirstNumber=centre_to_inside, SecondNumber=distance)  # -> SmallerThan, OrEqualTo
smaller_than_2 = SmallerThan(FirstNumber=centre_to_inside_2, SecondNumber=distance_2)  # -> SmallerThan, OrEqualTo
smaller_than_3 = SmallerThan(FirstNumber=centre_to_inside_3, SecondNumber=distance_3)  # -> SmallerThan, OrEqualTo
smaller_than_4 = SmallerThan(FirstNumber=centre_to_inside_4, SecondNumber=distance_4)  # -> SmallerThan, OrEqualTo
dispatch_5 = Dispatch(List=inside_points_unfiltered, DispatchPattern=smaller_than.SmallerThan)  # -> ListA, ListB
dispatch_6 = Dispatch(List=outside_points_unfiltered_3, DispatchPattern=smaller_than.SmallerThan)  # -> ListA, ListB
dispatch_7 = Dispatch(List=inside_points_unfiltered_4, DispatchPattern=smaller_than_2.SmallerThan)  # -> ListA, ListB
dispatch_8 = Dispatch(List=outside_points_unfiltered_4, DispatchPattern=smaller_than_2.SmallerThan)  # -> ListA, ListB
dispatch_9 = Dispatch(List=inside_points_unfiltered_3, DispatchPattern=smaller_than_3.SmallerThan)  # -> ListA, ListB
dispatch_10 = Dispatch(List=outside_points_unfiltered_2, DispatchPattern=smaller_than_3.SmallerThan)  # -> ListA, ListB
dispatch_11 = Dispatch(List=inside_points_unfiltered_2, DispatchPattern=smaller_than_4.SmallerThan)  # -> ListA, ListB
dispatch_12 = Dispatch(List=outside_points_unfiltered, DispatchPattern=smaller_than_4.SmallerThan)  # -> ListA, ListB
point = Point(dispatch_5.ListA)
point_2 = Point(dispatch_5.ListB)
point_3 = Point(dispatch_6.ListA)
point_4 = Point(dispatch_6.ListB)
point_5 = Point(dispatch_7.ListA)
point_6 = Point(dispatch_7.ListB)
point_7 = Point(dispatch_9.ListA)
point_8 = Point(dispatch_9.ListB)
point_9 = Point(dispatch_8.ListA)
point_10 = Point(dispatch_8.ListB)
point_11 = Point(dispatch_10.ListA)
point_12 = Point(dispatch_10.ListB)
point_13 = Point(dispatch_11.ListA)
point_14 = Point(dispatch_11.ListB)
point_15 = Point(dispatch_12.ListA)
point_16 = Point(dispatch_12.ListB)

shift_list = ShiftList(List=point, Shift=-1, Wrap=True)
shift_list_2 = ShiftList(List=point_4, Shift=0, Wrap=True)
shift_list_3 = ShiftList(List=point_13, Shift=0, Wrap=True)
shift_list_4 = ShiftList(List=point_16, Shift=1, Wrap=True)
shift_list_5 = ShiftList(List=point_5, Shift=0, Wrap=True)
shift_list_6 = ShiftList(List=point_10, Shift=1, Wrap=True)
shift_list_7 = ShiftList(List=point_7, Shift=0, Wrap=True)
shift_list_8 = ShiftList(List=point_12, Shift=1, Wrap=True)

shift_list_9 = ShiftList(List=point_3, Shift=0, Wrap=True)
shift_list_10 = ShiftList(List=point_2, Shift=0, Wrap=True)
shift_list_11 = ShiftList(List=point_15, Shift=0, Wrap=True)
shift_list_12 = ShiftList(List=point_14, Shift=0, Wrap=True)
shift_list_13 = ShiftList(List=point_9, Shift=0, Wrap=True)
shift_list_14 = ShiftList(List=point_6, Shift=0, Wrap=True)
shift_list_15 = ShiftList(List=point_11, Shift=0, Wrap=True)
shift_list_16 = ShiftList(List=point_8, Shift=0, Wrap=True)

# ----
# Outer Points
shape_1_3 = Merge(Data1=shift_list_9, Data2=shift_list_10)
shape_2_3 = Merge(Data1=shift_list_12, Data2=shift_list_11)
shape_3_3 = Merge(Data1=shift_list_13, Data2=shift_list_14)
shape_4_3 = Merge(Data1=shift_list_15, Data2=shift_list_16)

# ----
# Inner Points
shape_1_4 = Merge(Data1=shift_list, Data2=shift_list_2)
shape_2_4 = Merge(Data1=shift_list_3, Data2=shift_list_4)
shape_3_4 = Merge(Data1=shift_list_5, Data2=shift_list_6)
shape_4_4 = Merge(Data1=shift_list_7, Data2=shift_list_8)

result = ClusterOutput(shape_1_3)
result_2 = ClusterOutput(shape_2_3)
result_3 = ClusterOutput(shape_3_3)
result_4 = ClusterOutput(shape_4_3)
result_5 = ClusterOutput(shape_1_4)
result_6 = ClusterOutput(shape_2_4)
result_7 = ClusterOutput(shape_3_4)
result_8 = ClusterOutput(shape_4_4)
points = ClusterOutput(shape_1_2.Points)
points_2 = ClusterOutput(shape_2_2.Points)
points_3 = ClusterOutput(shape_3_2.Points)
# Adjust rotation on individual basis here
points_4 = ClusterOutput(shape_4_2.Points)
motion = ClusterInput()
motion_2 = ClusterInput()
motion_3 = ClusterInput()
motion_4 = ClusterInput()
motion_5 = ClusterInput()
# Height Control
motion_6 = ClusterInput()
motion_7 = ClusterInput()
motion_8 = ClusterInput()

# ----
# Inner to Bounding Lines
shift_list_17 = ShiftList(List=shape_1_4, Shift=1, Wrap=True)
shift_list_18 = ShiftList(List=shape_2_4, Shift=1, Wrap=True)
shift_list_19 = ShiftList(List=shape_3_4, Shift=0, Wrap=True)
shift_list_20 = ShiftList(List=shape_4_4, Shift=1, Wrap=True)
line = Line(StartPoint=shift_list_17, EndPoint=shape_1_2.Points)
line_2 = Line(StartPoint=shift_list_18, EndPoint=shape_2_2.Points)
line_3 = Line(StartPoint=shift_list_19, EndPoint=shape_3_2.Points)
line_4 = Line(StartPoint=shift_list_20, EndPoint=shape_4_2.Points)

move = Move(Geometry=shape_1_3, Motion=motion)  # -> Geometry, Transform
move_2 = Move(Geometry=shape_2_3, Motion=motion_2)  # -> Geometry, Transform
move_3 = Move(Geometry=shape_3_3, Motion=motion_3)  # -> Geometry, Transform
move_4 = Move(Geometry=shape_4_3, Motion=motion_4)  # -> Geometry, Transform

move_5 = Move(Geometry=shape_1_4, Motion=motion_5)  # -> Geometry, Transform
move_6 = Move(Geometry=shape_2_4, Motion=motion_6)  # -> Geometry, Transform
move_7 = Move(Geometry=shape_3_4, Motion=motion_7)  # -> Geometry, Transform
move_8 = Move(Geometry=shape_4_4, Motion=motion_8)  # -> Geometry, Transform

# ----
# Centre to Inner Lines
line_5 = Line(StartPoint=polygon_center.CenterV, EndPoint=shape_1_4)
line_6 = Line(StartPoint=polygon_center_2.CenterV, EndPoint=shape_2_4)
line_7 = Line(StartPoint=polygon_center_3.CenterV, EndPoint=shape_3_4)
line_8 = Line(StartPoint=polygon_center_4.CenterV, EndPoint=shape_4_4)

# ----
# Centre to Outer Lines
line_9 = Line(StartPoint=polygon_center.CenterV, EndPoint=shape_1_3)
line_10 = Line(StartPoint=polygon_center_2.CenterV, EndPoint=shape_2_3)
line_11 = Line(StartPoint=polygon_center_3.CenterV, EndPoint=shape_3_3)
line_12 = Line(StartPoint=polygon_center_4.CenterV, EndPoint=shape_4_3)

line_13 = Line(StartPoint=move.Geometry, EndPoint=shape_1_3)
line_14 = Line(StartPoint=move_2.Geometry, EndPoint=shape_2_3)
line_15 = Line(StartPoint=move_3.Geometry, EndPoint=shape_3_3)
line_16 = Line(StartPoint=move_4.Geometry, EndPoint=shape_4_3)

line_17 = Line(StartPoint=move_5.Geometry, EndPoint=shape_1_4)
line_18 = Line(StartPoint=move_6.Geometry, EndPoint=shape_2_4)
line_19 = Line(StartPoint=move_7.Geometry, EndPoint=shape_3_4)
line_20 = Line(StartPoint=move_8.Geometry, EndPoint=shape_4_4)

bezier_span = BezierSpan(StartPoint=polygon_center_2.CenterV, StartTangent=line_6, EndPoint=move_6.Geometry, EndTangent=line_18)  # -> Curve, Length, Domain
bezier_span_2 = BezierSpan(StartPoint=polygon_center_4.CenterV, StartTangent=line_8, EndPoint=move_8.Geometry, EndTangent=line_20)  # -> Curve, Length, Domain
bezier_span_3 = BezierSpan(StartPoint=polygon_center.CenterV, StartTangent=line_5, EndPoint=move_5.Geometry, EndTangent=line_17)  # -> Curve, Length, Domain
bezier_span_4 = BezierSpan(StartPoint=polygon_center_3.CenterV, StartTangent=line_7, EndPoint=move_7.Geometry, EndTangent=line_19)  # -> Curve, Length, Domain

bezier_span_5 = BezierSpan(StartPoint=polygon_center.CenterV, StartTangent=line_9, EndPoint=move.Geometry, EndTangent=line_13)  # -> Curve, Length, Domain
bezier_span_6 = BezierSpan(StartPoint=polygon_center_2.CenterV, StartTangent=line_10, EndPoint=move_2.Geometry, EndTangent=line_14)  # -> Curve, Length, Domain
bezier_span_7 = BezierSpan(StartPoint=polygon_center_3.CenterV, StartTangent=line_11, EndPoint=move_3.Geometry, EndTangent=line_15)  # -> Curve, Length, Domain
bezier_span_8 = BezierSpan(StartPoint=polygon_center_4.CenterV, StartTangent=line_12, EndPoint=move_4.Geometry, EndTangent=line_16)  # -> Curve, Length, Domain

panel_7 = Panel("""1
0""")

weave = Weave(Pattern=panel_7, Stream0=bezier_span.Curve, Stream1=bezier_span_6.Curve, NullGaps=False)
weave_2 = Weave(Pattern=panel_7, Stream0=bezier_span_4.Curve, Stream1=bezier_span_7.Curve, NullGaps=False)
weave_3 = Weave(Pattern=panel_7, Stream0=bezier_span_2.Curve, Stream1=bezier_span_8.Curve, NullGaps=False)
weave_4 = Weave(Pattern=panel_7, Stream0=bezier_span_5.Curve, Stream1=bezier_span_3.Curve, NullGaps=False)

loft_options = LoftOptions(Closed=True, Adjust=False, Rebuild=0, Refit=0, Type=3)
weave_5 = ClusterOutput(weave)
weave_6 = ClusterOutput(weave_2)
weave_7 = ClusterOutput(weave_3)
weave_8 = ClusterOutput(weave_4)
options = ClusterOutput(loft_options)

# ==== cluster Cluster_5
number_slider = Slider(1, range=0..1)
_2_uniform_tiling_c = _2UniformTilingC(Plane=PlaneXY(0, 0, 0), Size=1, ExtendX=number_slider, ExtendY=number_slider)
list_length = ListLength(List=_2_uniform_tiling_c)
list = ClusterInput()
partition_list = PartitionList(List=list, Size=list_length)
number_slider_2 = Slider(0, range=0..16)
sub_list = SubList(List=partition_list, Domain=[Domain(2, 2), Domain(6, 10), Domain(14, 14)], Wrap=True)  # -> flatten(List), Index
list_item = ListItem(List=partition_list, Index=Slider(0, range=0..30), Wrap=True)
sub_list_2 = SubList(List=partition_list, Domain=[Domain(0, 1), Domain(3, 5), Domain(11, 13)], Wrap=True)  # -> List, Index
list_2 = ClusterOutput(sub_list.List)
panel = Panel("""1
0
0""")
list_item_2 = ListItem(List=sub_list_2.List, Index=0, Wrap=True)  # -> flatten(Item)
list_item_3 = ListItem(List=sub_list_2.List, Index=2, Wrap=True)  # -> flatten(Item)
list_item_4 = ListItem(List=sub_list_2.List, Index=1, Wrap=True)  # -> flatten(Item)
dispatch = Dispatch(List=list_item_3, DispatchPattern=panel)  # -> ListA, ListB
panel_2 = Panel("""1
1
0""")
panel_3 = Panel("""1
0
0""")
dispatch_2 = Dispatch(List=list_item_4, DispatchPattern=panel_3)  # -> ListA, ListB
dispatch_3 = Dispatch(List=list_item_2, DispatchPattern=panel_2)  # -> ListA, ListB
dispatch_4 = Dispatch(List=dispatch.ListB, DispatchPattern=[True, False])  # -> ListA, ListB
control_points = ControlPoints(Curve=dispatch_2.ListB)  # -> Points, Weights, Knots
control_points_2 = ControlPoints(Curve=dispatch_2.ListA)  # -> Points, Weights, Knots
control_points_3 = ControlPoints(Curve=dispatch_3.ListB)  # -> Points, Weights, Knots
control_points_4 = ControlPoints(Curve=dispatch_3.ListA)  # -> Points, Weights, Knots
control_points_5 = ControlPoints(Curve=dispatch_4.ListB)  # -> Points, Weights, Knots
control_points_6 = ControlPoints(Curve=dispatch_4.ListA)  # -> Points, Weights, Knots
cull_duplicates = CullDuplicates(Points=control_points.Points, Tolerance=0.1, CullMode=3)  # -> Points, Indices, Valence
cull_duplicates_2 = CullDuplicates(Points=control_points_2.Points, Tolerance=0.1, CullMode=3)  # -> Points, Indices, Valence
cull_duplicates_3 = CullDuplicates(Points=control_points_3.Points, Tolerance=0.1, CullMode=3)  # -> Points, Indices, Valence
cull_duplicates_4 = CullDuplicates(Points=control_points_4.Points, Tolerance=0.1, CullMode=3)  # -> Points, Indices, Valence
curve = Curve(dispatch_3.ListA)
cull_duplicates_5 = CullDuplicates(Points=control_points_5.Points, Tolerance=0.1, CullMode=3)  # -> Points, Indices, Valence
cull_duplicates_6 = CullDuplicates(Points=control_points_6.Points, Tolerance=0.1, CullMode=3)  # -> Points, Indices, Valence
reverse_list = ReverseList(List=cull_duplicates_4.Points)
shift_list = ShiftList(List=cull_duplicates_3.Points, Shift=0, Wrap=True)
shift_list_2 = ShiftList(List=cull_duplicates.Points, Shift=0, Wrap=True)
shift_list_3 = ShiftList(List=cull_duplicates_2.Points, Shift=1, Wrap=True)
shift_list_4 = ShiftList(List=reverse_list, Shift=0, Wrap=True)
shift_list_5 = ShiftList(List=cull_duplicates_5.Points, Shift=0, Wrap=True)
shift_list_6 = ShiftList(List=cull_duplicates_6.Points, Shift=1, Wrap=True)
polyline = PolyLine(Vertices=shift_list, Closed=True)  # -> flatten(Polyline)
polyline_2 = PolyLine(Vertices=shift_list_2, Closed=True)  # -> flatten(Polyline)
polyline_3 = PolyLine(Vertices=shift_list_3, Closed=True)  # -> flatten(Polyline)
polyline_4 = PolyLine(Vertices=shift_list_4, Closed=True)  # -> flatten(Polyline)
polyline_5 = PolyLine(Vertices=shift_list_5, Closed=True)  # -> flatten(Polyline)
polyline_6 = PolyLine(Vertices=shift_list_6, Closed=True)  # -> flatten(Polyline)
polyline_7 = ClusterOutput(polyline)
polyline_8 = ClusterOutput(polyline_2)
polyline_9 = ClusterOutput(polyline_3)
polyline_10 = ClusterOutput(polyline_4)
polyline_11 = ClusterOutput(polyline_5)
polyline_12 = ClusterOutput(polyline_6)

# ==== cluster Cluster_6
list = ClusterInput()
number_slider = Slider(1, range=0..1)
rhombitrihexagonal = Rhombitrihexagonal(Plane=PlaneXY(0, 0, 0), Size=1, ExtendX=number_slider, ExtendY=number_slider)
list_length = ListLength(List=rhombitrihexagonal)
partition_list = PartitionList(List=list, Size=list_length)
panel = Panel("""0
0
0
0
1
0""")
sub_list = SubList(List=partition_list, Domain=Domain(4, 4), Wrap=True)  # -> List, Index
sub_list_2 = SubList(List=partition_list, Domain=[Domain(0, 3), Domain(5, 5)], Wrap=True)  # -> flatten(List), Index
panel_2 = ClusterOutput(panel)
control_points = ControlPoints(Curve=sub_list.List)  # -> Points, Weights, Knots
list_2 = ClusterOutput(sub_list_2.List)
cull_duplicates = CullDuplicates(Points=control_points.Points, Tolerance=0.1, CullMode=3)  # -> Points, Indices, Valence
shift_list = ShiftList(List=cull_duplicates.Points, Shift=1, Wrap=True)
polyline = PolyLine(Vertices=shift_list, Closed=True)  # -> flatten(Polyline)
polyline_2 = ClusterOutput(polyline)

# ==== cluster Cluster_7
number_slider = Slider(1, range=0..1)
snub_square = SnubSquare(Plane=PlaneXY(0, 0, 0), Size=1, ExtendX=number_slider, ExtendY=number_slider)
list = ClusterInput()
list_length = ListLength(List=snub_square)
partition_list = PartitionList(List=list, Size=list_length)
sub_list = SubList(List=partition_list, Domain=[Domain(0, 0), Domain(4, 5)], Wrap=True)  # -> flatten(List), Index
sub_list_2 = SubList(List=partition_list, Domain=Domain(1, 3), Wrap=True)  # -> List, Index
list_2 = ClusterOutput(sub_list.List)
list_item = ListItem(List=sub_list_2.List, Index=0, Wrap=True)
list_item_2 = ListItem(List=sub_list_2.List, Index=1, Wrap=True)
list_item_3 = ListItem(List=sub_list_2.List, Index=2, Wrap=True)
panel = Panel(sub_list_2.List)
control_points = ControlPoints(Curve=list_item)  # -> Points, Weights, Knots
control_points_2 = ControlPoints(Curve=list_item_2)  # -> Points, Weights, Knots
control_points_3 = ControlPoints(Curve=list_item_3)  # -> Points, Weights, Knots
cull_duplicates = CullDuplicates(Points=control_points.Points, Tolerance=0.1, CullMode=3)  # -> Points, Indices, Valence
cull_duplicates_2 = CullDuplicates(Points=control_points_2.Points, Tolerance=0.1, CullMode=3)  # -> Points, Indices, Valence
cull_duplicates_3 = CullDuplicates(Points=control_points_3.Points, Tolerance=0.1, CullMode=3)  # -> Points, Indices, Valence
shift_list = ShiftList(List=cull_duplicates.Points, Shift=-1, Wrap=True)  # -> reverse(List)
shift_list_2 = ShiftList(List=cull_duplicates_2.Points, Shift=0, Wrap=True)  # -> reverse(List)
shift_list_3 = ShiftList(List=cull_duplicates_3.Points, Shift=-1, Wrap=True)  # -> reverse(List)
polyline = PolyLine(Vertices=shift_list, Closed=True)  # -> flatten(Polyline)
polyline_2 = PolyLine(Vertices=shift_list_2, Closed=True)  # -> flatten(Polyline)
polyline_3 = PolyLine(Vertices=shift_list_3, Closed=True)  # -> flatten(Polyline)
merge = Merge(Data1=polyline, Data2=polyline_2, Data3=polyline_3)
result = ClusterOutput(merge)

# ==== cluster Cluster_8
number_slider = Slider(1, range=0..1)
snub_trihexagonal = SnubTrihexagonal(Plane=PlaneXY(0, 0, 0), Size=1, ExtendX=number_slider, ExtendY=number_slider)
list_length = ListLength(List=snub_trihexagonal)
list = ClusterInput()
partition_list = PartitionList(List=list, Size=list_length)
list_item = ListItem(List=partition_list, Index=Slider(0, range=0..27), Wrap=True)  # -> flatten(Item)
sub_list = SubList(List=partition_list, Domain=[Domain(1, 8), Domain(10, 17), Domain(19, 26)], Wrap=True)  # -> flatten(List), Index
sub_list_2 = SubList(List=partition_list, Domain=[Domain(9, 9), Domain(18, 18)], Wrap=True)  # -> List, Index
dispatch = Dispatch(List=list_item, DispatchPattern=[True, False])  # -> ListA, ListB
control_points = ControlPoints(Curve=dispatch.ListA)  # -> Points, Weights, Knots
control_points_2 = ControlPoints(Curve=dispatch.ListB)  # -> Points, Weights, Knots
list_item_2 = ListItem(List=sub_list_2.List, Index=0, Wrap=True)
control_points_3 = ControlPoints(Curve=list_item_2)  # -> Points, Weights, Knots
cull_duplicates = CullDuplicates(Points=control_points.Points, Tolerance=0.1, CullMode=3)  # -> Points, Indices, Valence
cull_duplicates_2 = CullDuplicates(Points=control_points_2.Points, Tolerance=0.1, CullMode=3)  # -> Points, Indices, Valence
cull_duplicates_3 = CullDuplicates(Points=control_points_3.Points, Tolerance=0.1, CullMode=3)  # -> Points, Indices, Valence
shift_list = ShiftList(List=cull_duplicates_2.Points, Shift=0, Wrap=True)
polyline = PolyLine(Vertices=cull_duplicates.Points, Closed=True)  # -> flatten(Polyline)
reverse_list = ReverseList(List=shift_list)
shift_list_2 = ShiftList(List=cull_duplicates_3.Points, Shift=1, Wrap=True)
polyline_2 = PolyLine(Vertices=reverse_list, Closed=True)  # -> flatten(Polyline)
reverse_list_2 = ReverseList(List=shift_list_2)
polyline_3 = PolyLine(Vertices=reverse_list_2, Closed=True)  # -> flatten(Polyline)
weave = Weave(Pattern=[0, 1], Stream0=polyline, Stream1=polyline_2, NullGaps=False)
weave_2 = ClusterOutput(weave)
insert_items = InsertItems(List=sub_list.List, Item=polyline_3, Indices=9, Wrap=True)
list_2 = ClusterOutput(insert_items)

# ==== cluster Cluster_9
number_slider = Slider(1, range=0..1)
_2_uniform_tiling_d = _2UniformTilingD(Plane=PlaneXY(0, 0, 0), Size=1, ExtendX=number_slider, ExtendY=number_slider)
list = ClusterInput()
list_length = ListLength(List=_2_uniform_tiling_d)
partition_list = PartitionList(List=list, Size=list_length)
sub_list = SubList(List=partition_list, Domain=[Domain(7, 7), Domain(13, 13), Domain(17, 17)], Wrap=True)  # -> flatten(List), Index
sub_list_2 = SubList(List=partition_list, Domain=[Domain(0, 6), Domain(8, 8), Domain(10, 12), Domain(14, 16)], Wrap=True)  # -> flatten(List), Index
sub_list_3 = SubList(List=partition_list, Domain=Domain(9, 9), Wrap=True)  # -> List, Index
panel = Panel("""0
0
1""")
list_2 = ClusterOutput(sub_list_2.List)
dispatch = Dispatch(List=sub_list.List, DispatchPattern=panel)  # -> ListA, ListB
control_points = ControlPoints(Curve=sub_list_3.List)  # -> Points, Weights, Knots
cull_duplicates = CullDuplicates(Points=control_points.Points, Tolerance=0.1, CullMode=3)  # -> Points, Indices, Valence
control_points_2 = ControlPoints(Curve=dispatch.ListA)  # -> Points, Weights, Knots
control_points_3 = ControlPoints(Curve=dispatch.ListB)  # -> Points, Weights, Knots
shift_list = ShiftList(List=cull_duplicates.Points, Shift=0, Wrap=True)
cull_duplicates_2 = CullDuplicates(Points=control_points_2.Points, Tolerance=0.1, CullMode=3)  # -> Points, Indices, Valence
cull_duplicates_3 = CullDuplicates(Points=control_points_3.Points, Tolerance=0.1, CullMode=3)  # -> Points, Indices, Valence
reverse_list = ReverseList(List=shift_list)
shift_list_2 = ShiftList(List=cull_duplicates_2.Points, Shift=1, Wrap=True)
shift_list_3 = ShiftList(List=cull_duplicates_3.Points, Shift=0, Wrap=True)
polyline = PolyLine(Vertices=reverse_list, Closed=True)  # -> flatten(Polyline)
polyline_2 = PolyLine(Vertices=shift_list_2, Closed=True)  # -> flatten(Polyline)
polyline_3 = PolyLine(Vertices=shift_list_3, Closed=True)  # -> flatten(Polyline)
polyline_4 = ClusterOutput(polyline)
polyline_5 = ClusterOutput(polyline_2)
polyline_6 = ClusterOutput(polyline_3)

# ==== cluster Cluster_10
number_slider = Slider(1, range=0..1)
_2_uniform_tiling_e = _2UniformTilingE(Plane=PlaneXY(0, 0, 0), Size=1, ExtendX=number_slider, ExtendY=number_slider)
list_length = ListLength(List=_2_uniform_tiling_e)
list = ClusterInput()
partition_list = PartitionList(List=list, Size=list_length)
sub_list = SubList(List=partition_list, Domain=Domain(0, 0), Wrap=True)  # -> flatten(List), Index
sub_list_2 = SubList(List=partition_list, Domain=Domain(1, 1), Wrap=True)  # -> flatten(List), Index
sub_list_3 = SubList(List=partition_list, Domain=Domain(4, 5), Wrap=True)  # -> flatten(List), Index
sub_list_4 = SubList(List=partition_list, Domain=Domain(2, 3), Wrap=True)  # -> flatten(List), Index
list_2 = ClusterOutput(sub_list_4.List)
control_points = ControlPoints(Curve=sub_list.List)  # -> Points, Weights, Knots
control_points_2 = ControlPoints(Curve=sub_list_2.List)  # -> Points, Weights, Knots
control_points_3 = ControlPoints(Curve=sub_list_3.List)  # -> Points, Weights, Knots
cull_duplicates = CullDuplicates(Points=control_points.Points, Tolerance=0.1, CullMode=3)  # -> Points, Indices, Valence
cull_duplicates_2 = CullDuplicates(Points=control_points_2.Points, Tolerance=0.1, CullMode=3)  # -> Points, Indices, Valence
cull_duplicates_3 = CullDuplicates(Points=control_points_3.Points, Tolerance=0.1, CullMode=3)  # -> Points, Indices, Valence
reverse_list = ReverseList(List=cull_duplicates_2.Points)
shift_list = ShiftList(List=cull_duplicates.Points, Shift=1, Wrap=True)
shift_list_2 = ShiftList(List=cull_duplicates_3.Points, Shift=1, Wrap=True)
shift_list_3 = ShiftList(List=reverse_list, Shift=1, Wrap=True)
polyline = PolyLine(Vertices=shift_list, Closed=True)  # -> flatten(Polyline)
polyline_2 = PolyLine(Vertices=shift_list_2, Closed=True)  # -> flatten(Polyline)
polyline_3 = PolyLine(Vertices=shift_list_3, Closed=True)  # -> flatten(Polyline)
polyline_4 = ClusterOutput(polyline)
polyline_5 = ClusterOutput(polyline_2)
polyline_6 = ClusterOutput(polyline_3)

# ==== cluster Cluster_11
number_slider = Slider(1, range=0..1)
_2_uniform_tiling_f = _2UniformTilingF(Plane=PlaneXY(0, 0, 0), Size=1, ExtendX=number_slider, ExtendY=number_slider)
list_length = ListLength(List=_2_uniform_tiling_f)
list = ClusterInput()
partition_list = PartitionList(List=list, Size=list_length)
sub_list = SubList(List=partition_list, Domain=[Domain(4, 5), Domain(7, 8), Domain(10, 11), Domain(13, 14)], Wrap=True)  # -> List, Index
sub_list_2 = SubList(List=partition_list, Domain=[Domain(0, 3), Domain(6, 6), Domain(9, 9), Domain(12, 12), Domain(15, 15)], Wrap=True)  # -> flatten(List), Index
list_2 = ClusterOutput(sub_list_2.List)
dispatch = Dispatch(List=sub_list.List, DispatchPattern=[True, False])  # -> ListA, ListB
control_points = ControlPoints(Curve=dispatch.ListA)  # -> Points, Weights, Knots
control_points_2 = ControlPoints(Curve=dispatch.ListB)  # -> Points, Weights, Knots
cull_duplicates = CullDuplicates(Points=control_points.Points, Tolerance=0.1, CullMode=3)  # -> Points, Indices, Valence
cull_duplicates_2 = CullDuplicates(Points=control_points_2.Points, Tolerance=0.1, CullMode=3)  # -> Points, Indices, Valence
shift_list = ShiftList(List=cull_duplicates.Points, Shift=0, Wrap=True)
shift_list_2 = ShiftList(List=cull_duplicates_2.Points, Shift=1, Wrap=True)
polyline = PolyLine(Vertices=shift_list, Closed=True)  # -> flatten(Polyline)
polyline_2 = PolyLine(Vertices=shift_list_2, Closed=True)  # -> flatten(Polyline)
polyline_3 = ClusterOutput(polyline)
polyline_4 = ClusterOutput(polyline_2)

# ==== cluster Cluster_12
number_slider = Slider(1, range=0..1)
_4_uniform_tiling_a = _4UniformTilingA(Plane=PlaneXY(0, 0, 0), Size=1, ExtendX=number_slider, ExtendY=number_slider)
list_length = ListLength(List=_4_uniform_tiling_a)
list = ClusterInput()
partition_list = PartitionList(List=list, Size=list_length)
list_item = ListItem(List=partition_list, Index=Slider(29, range=0..65), Wrap=True)
sub_list = SubList(List=partition_list, Domain=Domain(8, 8), Wrap=True)  # -> List, Index
sub_list_2 = SubList(
    List=partition_list,
    Domain=[Domain(5, 5), Domain(7, 7), Domain(14, 14), Domain(17, 17), Domain(22, 22), Domain(24, 24), Domain(30, 30), Domain(31, 31)],
    Wrap=True)  # -> List, Index
sub_list_3 = SubList(List=partition_list, Domain=Domain(26, 26), Wrap=False)  # -> List, Index
sub_list_4 = SubList(
    List=partition_list,
    Domain=[Domain(4, 4), Domain(13, 13), Domain(16, 16), Domain(23, 23), Domain(25, 25), Domain(28, 28), Domain(32, 32)],
    Wrap=True)  # -> List, Index
sub_list_5 = SubList(
    List=partition_list,
    Domain=[Domain(0, 0), Domain(2, 2), Domain(6, 6), Domain(9, 9), Domain(10, 10), Domain(11, 11), Domain(15, 15), Domain(18, 18), Domain(19, 19), Domain(21, 21), Domain(27, 27), Domain(29, 29)],
    Wrap=True)  # -> List, Index
control_points = ControlPoints(Curve=sub_list_3.List)  # -> Points, Weights, Knots
control_points_2 = ControlPoints(Curve=sub_list.List)  # -> Points, Weights, Knots
control_points_3 = ControlPoints(Curve=sub_list_2.List)  # -> Points, Weights, Knots
control_points_4 = ControlPoints(Curve=sub_list_4.List)  # -> Points, Weights, Knots
control_points_5 = ControlPoints(Curve=sub_list_5.List)  # -> Points, Weights, Knots
cull_duplicates = CullDuplicates(Points=control_points.Points, Tolerance=0.1, CullMode=3)  # -> Points, Indices, Valence
cull_duplicates_2 = CullDuplicates(Points=control_points_2.Points, Tolerance=0.1, CullMode=3)  # -> Points, Indices, Valence
cull_duplicates_3 = CullDuplicates(Points=control_points_3.Points, Tolerance=0.1, CullMode=3)  # -> Points, Indices, Valence
cull_duplicates_4 = CullDuplicates(Points=control_points_4.Points, Tolerance=0.1, CullMode=3)  # -> Points, Indices, Valence
cull_duplicates_5 = CullDuplicates(Points=control_points_5.Points, Tolerance=0.1, CullMode=3)  # -> Points, Indices, Valence
shift_list = ShiftList(List=cull_duplicates.Points, Shift=1, Wrap=True)
shift_list_2 = ShiftList(List=cull_duplicates_2.Points, Shift=0, Wrap=True)
shift_list_3 = ShiftList(List=cull_duplicates_3.Points, Shift=0, Wrap=True)
shift_list_4 = ShiftList(List=cull_duplicates_4.Points, Shift=-1, Wrap=True)
shift_list_5 = ShiftList(List=cull_duplicates_5.Points, Shift=1, Wrap=True)
polyline = PolyLine(Vertices=shift_list, Closed=True)  # -> flatten(Polyline)
polyline_2 = PolyLine(Vertices=shift_list_2, Closed=True)  # -> flatten(Polyline)
polyline_3 = PolyLine(Vertices=shift_list_3, Closed=True)  # -> flatten(Polyline)
polyline_4 = PolyLine(Vertices=shift_list_5, Closed=True)  # -> flatten(Polyline)
polyline_5 = PolyLine(Vertices=shift_list_4, Closed=True)  # -> flatten(Polyline)
sub_list_6 = SubList(List=partition_list, Domain=[Domain(1, 1), Domain(3, 3), Domain(12, 12), Domain(20, 20)], Wrap=True)  # -> flatten(List), Index
polyline_6 = ClusterOutput(polyline)
polyline_7 = ClusterOutput(polyline_2)
polyline_8 = ClusterOutput(polyline_3)
polyline_9 = ClusterOutput(polyline_4)
polyline_10 = ClusterOutput(polyline_5)
list_2 = ClusterOutput(sub_list_6.List)

# ==== cluster Cluster_13
number_slider = Slider(2, range=0..2)
Y = ClusterInput()
X = ClusterInput()
Y_2 = Number(Y)
X_2 = Number(X)
subtraction = Subtraction(A=X_2, B=Slider(2, range=0..10))
equality = Equality(FirstNumber=X_2, SecondNumber=number_slider)  # -> Equality, Inequality
larger_than = LargerThan(FirstNumber=X_2, SecondNumber=number_slider)  # -> LargerThan, OrEqualTo
equality_2 = Equality(FirstNumber=X_2, SecondNumber=Slider(1, range=0..1))  # -> Equality, Inequality
number_slider_2 = Slider(14, range=0..100)
multiplication = Multiplication(A=Slider(6, range=0..10), B=subtraction)
number_slider_3 = Slider(10, range=0..10)
number_slider_4 = Slider(6, range=0..10)
subtraction_2 = Subtraction(A=X_2, B=Slider(2, range=0..10))
multiplication_2 = Multiplication(A=number_slider_4, B=subtraction_2)
addition = Addition(A=number_slider_2, B=multiplication)
addition_2 = Addition(A=number_slider_3, B=multiplication_2)
stream_gate = StreamGate(Stream=Slider(10, range=0..10), Gate=equality_2.Equality)  # -> Target0, Target1
stream_gate_2 = StreamGate(Stream=number_slider_2, Gate=equality.Equality)  # -> Target0, Target1
stream_gate_3 = StreamGate(Stream=addition, Gate=larger_than.LargerThan)  # -> Target0, Target1
stream_gate_4 = StreamGate(Stream=number_slider_4, Gate=equality_2.Equality)  # -> Target0, Target1
stream_gate_5 = StreamGate(Stream=addition_2, Gate=larger_than.LargerThan)  # -> Target0, Target1
stream_gate_6 = StreamGate(Stream=number_slider_3, Gate=equality.Equality)  # -> Target0, Target1
merge = Merge(Data1=stream_gate.Target1, Data2=stream_gate_2.Target1, Data3=stream_gate_3.Target1)
panel = Panel(stream_gate_4.Target1)
panel_2 = Panel(stream_gate_4.Target0)
panel_3 = Panel(stream_gate_5.Target0)
panel_4 = Panel(stream_gate_5.Target1)
panel_5 = Panel(stream_gate_6.Target0)
panel_6 = Panel(stream_gate_6.Target1)
subtraction_3 = Subtraction(A=Y_2, B=Slider(2, range=0..2))
merge_2 = Merge(Data1=panel, Data2=panel_6, Data3=panel_4)
equality_3 = Equality(FirstNumber=Y_2, SecondNumber=Slider(1, range=0..1))  # -> Equality, Inequality
larger_than_2 = LargerThan(FirstNumber=Y_2, SecondNumber=Slider(2, range=0..2))  # -> LargerThan, OrEqualTo
stream_gate_7 = StreamGate(Stream=merge_2, Gate=equality_3.Equality)  # -> Target0, Target1
stream_gate_8 = StreamGate(Stream=stream_gate_7.Target0, Gate=larger_than_2.OrEqualTo)  # -> Target0, flatten(Target1)
loop_start = LoopStart(Repeat=subtraction_3, Trigger=Button(), Data=stream_gate_8.Target1, List=stream_gate_8.Target1)  # -> port, Counter, Data, Data_2
null_item = NullItem(Item=loop_start.Data)  # -> NullFlags, InvalidFlags, Description
addition_3 = Addition(A=loop_start.Data, B=merge)
stream_gate_9 = StreamGate(Stream=addition_3, Gate=null_item.NullFlags)  # -> Target0, Target1
insert_items = InsertItems(List=loop_start.Data_2, Item=stream_gate_9.Target0, Indices=Slider(0, range=0..100), Wrap=True)
loop_end = LoopEnd(
    port=loop_start.port,
    Exit=False,
    Data=addition_3,
    Data_2=insert_items,
    TimeOutVal=0,
    pausedState=False,
    state="Constant output")  # -> Data, List
clean_tree = CleanTree(RemoveNulls=True, RemoveInvalid=True, RemoveEmpty=False, Tree=loop_end.List)
panel_7 = Panel(clean_tree)
merge_3 = Merge(Data1=stream_gate_7.Target1, Data2=panel_7, Data3=stream_gate_7.Target0)  # -> flatten(Result)
merge_4 = Merge(Data1=merge_3)  # -> graft(Result)
panel_8 = Panel(merge_4)
list_item = ListItem(List=panel_8, Index=0, Wrap=True)
addition_4 = Addition(A=list_item, B=Slider(1, range=0..1))  # -> flatten(Result)
merge_5 = Merge(Data1=merge_3, Data2=addition_4)
panel_9 = Panel(addition_4)
list = ClusterInput()
cull_index = CullIndex(List=list, Indices=merge_5, Wrap=True)
list_2 = ClusterOutput(cull_index)
